# Grasshopper definition 151201_Pendent.gh (Grasshopper 0.9.76)

# ----
# CYAN - Notes
# RED - Input
# GREEN - Output
# YELLOW - Visual Gauge
# BLACK - Rhino Inputs
panel = Panel("")

crv = Curve(<curve referenced from the Rhino model>)
crv_2 = Curve(<curve referenced from the Rhino model>)
pframes = PerpFrames(Curve=crv, Count=10, Align=True)  # -> Frames, Parameters
curvature = Curvature(Curve=crv, Parameter=pframes.Parameters)  # -> P, unitize(K), C
expression = Expression(x=Slider(2, range=1..10), Expression="Format(\"-{0} to {0}\", x)")
Z = UnitZ(Factor=1)
pl = ConstructPlane(Origin=curvature.P, XAxis=curvature.K, YAxis=Z)
planesrf = PlaneSurface(Plane=pl, XSize=expression, YSize=expression)
bcx = BrepCurve(Brep=planesrf, Curve=crv_2)  # -> Curves, Points
dist = Distance(PointA=graft(curvature.P), PointB=bcx.Points)
panel_6 = Panel(dist)
