# Grasshopper definition 170927_Pendent_01.gh (Grasshopper 0.9.76)

crv = Curve([<curve referenced from the Rhino model> x3])
crv_2 = Curve(<curve referenced from the Rhino model>)
item = ListItem(List=crv, Index=Slider(0, range=0..2), Wrap=True)
pframes = PerpFrames(Curve=item, Count=Slider(16, range=0..50), Align=True)  # -> Frames, Parameters
deplane = DeconstructPlane(Plane=pframes.Frames)  # -> Origin, XAxis, YAxis, ZAxis
lng = ListLength(List=pframes.Frames)
division = Division(A=lng, B="2")
dom = ConstructDomain(DomainStart=Slider(0, range=0..100), DomainEnd=Slider(0.0625, range=0..1))
expression = Expression(x=division, Expression="Floor(x)")
range = Range(Domain=dom, Steps=expression)  # -> flatten(Range)
rev = ReverseList(List=range)
split = SplitList(List=rev, Index=1)  # -> ListA, flatten(ListB)
merge = Merge(Data1=range, Data2=split.ListB)
amp = Amplitude(Vector=unitize(deplane.YAxis), Amplitude=merge)
panel = Panel(merge)
amp_2 = Amplitude(Vector=unitize(deplane.XAxis), Amplitude=merge)
rev_2 = Reverse(Vector=amp)
rev_3 = Reverse(Vector=amp_2)
move = Move(Geometry=pframes.Frames, Motion=amp)  # -> Geometry, Transform
move_2 = Move(Geometry=pframes.Frames, Motion=amp_2)  # -> Geometry, Transform
move_3 = Move(Geometry=pframes.Frames, Motion=rev_2)  # -> Geometry, Transform
move_4 = Move(Geometry=pframes.Frames, Motion=rev_3)  # -> Geometry, Transform
pt = Point(move.Geometry)
pt_2 = Point(move_2.Geometry)
pt_3 = Point(move_3.Geometry)
pt_4 = Point(move_4.Geometry)
intcrv = Interpolate(Vertices=pt, Degree=3, Periodic=False, KnotStyle=1)  # -> Curve, Length, Domain
intcrv_2 = Interpolate(Vertices=pt_2, Degree=3, Periodic=False, KnotStyle=1)  # -> Curve, Length, Domain
intcrv_3 = Interpolate(Vertices=pt_3, Degree=3, Periodic=False, KnotStyle=1)  # -> Curve, Length, Domain
intcrv_4 = Interpolate(Vertices=pt_4, Degree=3, Periodic=False, KnotStyle=1)  # -> Curve, Length, Domain
nurbs = NurbsCurve(Vertices=pt_3, Degree=3, Periodic=False)  # -> Curve, Length, Domain
nurbs_2 = NurbsCurve(Vertices=pt_4, Degree=3, Periodic=False)  # -> Curve, Length, Domain
nurbs_3 = NurbsCurve(Vertices=pt, Degree=3, Periodic=False)  # -> Curve, Length, Domain
nurbs_4 = NurbsCurve(Vertices=pt_2, Degree=3, Periodic=False)  # -> Curve, Length, Domain
viewer = ParamViewer(intcrv_4.Curve)
merge_2 = Merge(Data1=intcrv_3.Curve, Data2=intcrv_4.Curve, Data3=intcrv.Curve, Data4=intcrv_2.Curve)
loft = Loft(Curves=merge_2, Options={Adjust=False, Closed=True, LoftEnds=0, LoftSimp=0, LoftType=0, Rebuild=10, Refit=0.01})
